# Grasshopper definition virtualAgent2_Gal.gh (Grasshopper 0.9.76)
# plug-ins: Python Interpreter

vec = VectorXYZ(XComponent=Slider(0, range=0..50), YComponent=Slider(0, range=0..50), ZComponent=Slider(0, range=0..50))  # -> Vector, Length

msphere = MeshSphere(
    Base=PlaneXY(0, 0, 0),
    Radius=Slider(9.312, range=0..12),
    UCount=Slider(32, range=0..100),
    VCount=Slider(34, range=0..100))
move = Move(Geometry=msphere, Motion=vec.Vector)  # -> Geometry, Transform
mesh = Mesh(move.Geometry)
demesh = DeconstructMesh(Mesh=mesh)  # -> Vertices, Faces, Colours, Normals
data = Data(demesh.Vertices)
pdecon = Deconstruct(Point=data)  # -> XComponent, YComponent, ZComponent
python = PythonScript(x=pdecon.XComponent, y=pdecon.YComponent)  # -> out, a
# ---------- python: Python ----------
def quadrant():
    if (x >= 0 and y >= 0):
        return 0
    elif (x < 0 and y >= 0):
        return 1
    elif (x < 0 and y < 0):
        return 2
    elif (x >= 0 and y < 0):
        return 3


q = 2 * quadrant()
y_larger = abs(y) >= abs(x)
if ((y_larger and (q == 0 or q == 4)) or (not y_larger and (q == 2 or q == 6))):
    a = q + 1
else:
    a = q
# ---------- end python ----------

dom = ConstructDomain(DomainStart=Slider(0, range=0..1), DomainEnd=Slider(1, range=0..1))
lng = ListLength(List=data)
random = Random(Range=dom, Number=lng, Seed=Slider(21.666, range=0..100))

face = MeshFace(demesh.Faces)
factor = Slider(2.75, range=1..10)
expression = Expression(x=random, y=factor, Expression="sin(y * x)")

factor_2 = Slider(4.4, range=1..10)
factor_3 = Slider(3.4, range=1..10)
factor_4 = Slider(5.4, range=1..10)
factor_5 = Slider(6.4, range=1..10)
factor_6 = Slider(7.4, range=1..10)
factor_7 = Slider(8.4, range=1..10)
factor_8 = Slider(9.4, range=1..10)
factor_9 = Slider(1, range=1..10)
python_2 = PythonScript(
    index=python.a,
    value=expression,
    f0=factor_3,
    f1=factor_2,
    f2=factor_4,
    f3=factor_5,
    f4=factor_6,
    f5=factor_7,
    f6=factor_8,
    f7=factor_9)  # -> out, a
# ---------- python_2: Python ----------
a = {0 : f0, 
     1 : f1, 
     2 : f2,
     3 : f3,
     4 : f4,
     5 : f5,
     6 : f6,
     7 : f7}[index] * value
# ---------- end python_2 ----------

origin_point = Point(Point(0, 0, 0))

colour_picker = ColourPicker(PickedColour=RGB(137, 132, 219))
colour_picker_2 = ColourPicker(PickedColour=RGB(168, 181, 141))
colour_picker_3 = ColourPicker(PickedColour=RGB(0, 0, 0))
create_material = CreateMaterial(
    Diffuse=colour_picker,
    Specular=colour_picker_2,
    Emission=colour_picker_3,
    Transparency=Slider(0.243, range=0..1),
    Shine=Slider(8, range=0..100))

moveaway = MoveAwayFrom(Geometry=data, Emitter=origin_point, Distance=python_2.a)  # -> Geometry, Transform
conmesh = ConstructMesh(Vertices=moveaway.Geometry, Faces=face)
rotate = Rotate(Geometry=conmesh, Angle=Slider(13.247, range=0..50), Plane=PlaneXY(0, 0, 0))  # -> Geometry, Transform
shader = Shader(create_material)
custom_preview = CustomPreview(Geometry=rotate.Geometry, Shader=shader)
